# Grasshopper definition Make it possible.gh (Grasshopper 1.0.8)

py3 = Python3Script(x=Slider(17, range=0..1000), y=Slider(1.333, range=0..10))  # -> out, a
# ---------- py3: Python ----------
import Rhino.Geometry as rg
#RCS 
count=int(x)
step=y
unit=step
x0=70
y0=30
xlist=[x0]
ylist=[y0]
prex=0
prey=0
for i in range(1,count+1):

    if i%4==1:
        x=unit
        y=0
    elif i%4==2:
        x=0
        y=unit
    elif i%4==3:
        x=-unit
        y=0
    elif i%4==0:
        x=0
        y=-unit
        unit=unit+step
    xlist.append(x+prex+x0)
    ylist.append(y+prey+y0)
    prex=x
    prey=y
print(xlist)
print(ylist)

points=[]
for xi , yi in zip(xlist,ylist):
    points.append(rg.Point3d(xi,yi,0))

crv = rg.Polyline(points).ToNurbsCurve()
a=crv
out=points
# ---------- end py3 ----------
panel = Panel(py3.out)
vec = VectorXYZ(XComponent=0, YComponent=0, ZComponent=Slider(28, range=0..100))  # -> Vector, Length
crv = Curve(py3.a)
extr = Extrude(Base=crv, Direction=vec.Vector)
